# Grasshopper definition flatten_kangeroo.gh (Grasshopper 1.0.7)
# plug-ins: LunchBox, Kangaroo2 Components

srf = Surface(<surface referenced from the Rhino model>)
edges = BrepEdges(Brep=srf)  # -> Naked, Interior, NonManifold
graft = GraftTree(Tree=edges.Naked, IncludeEmptyLists=True, IncludeNullItems=True)
hex = HexagonCells(Surface=srf, UDivisions=Slider(14, range=0..100), VDivisions=Slider(14, range=0..100), TParameter=0.25)  # -> HexagonCells, Centers
crv = Curve(hex.HexagonCells)
planar = IsPlanar(Surface=crv, Interior=True)  # -> Planar, Plane
explode = Explode(Curve=hex.HexagonCells, Recursive=True)  # -> flatten(Segments), Vertices
item = ListItem(List=crv, Index=Slider(107, range=1..200), Wrap=True)
cp = ControlPoints(Curve=hex.HexagonCells)  # -> Points, Weights, Knots
divide = DivideCurve(Curve=graft, Count=10, Kinks=False)  # -> Points, Tangents, Parameters
dupln = RemoveDuplicateLines(Lines=explode.Segments, Tolerance=0.01)
flatten = FlattenTree(Tree=cp.Points, Path="{0}")
boundary = BoundarySurfaces(Edges=item)
duppt = RemoveDuplicatePts(Points=flatten, Tolerance=0.01)
show = Show(G=hex.HexagonCells)
crv_cp = CurveClosestPoint(Point=duppt, Curve=graft)  # -> Point, Parameter, Distance
length_line = LengthLine(Line=dupln, Strength=Slider(1, range=0..1))
coplanar = CoPlanar(Points=cp.Points, Strength=Slider(1000, range=0..1000))
ea = EqualAngle(Strength=1)
equals = Equality(FirstNumber=crv_cp.Distance, SecondNumber=0)  # -> Equality, Inequality
oncurve = OnCurve(Points=crv_cp.Point, Curve=graft, Strength=Slider(117, range=0..1000))
angle = Angle(Strength=1)
cull = CullPattern(List=crv_cp.Point, CullPattern=equals.Equality)
merge = Merge(Data1=show, Data2=length_line, Data3=coplanar, Data4=oncurve)
flatten_2 = FlattenTree(Tree=merge, Path="{0}")
solver = Solver(GoalObjects=flatten_2, Reset=Button(), Threshold=1e-15, Tolerance=0.01, On=Toggle(False))  # -> I, V, graft(O)
item_2 = ListItem(List=solver.O, Index=Slider(43, range=0..100), Wrap=True)
boundary_2 = BoundarySurfaces(Edges=solver.O)
viewer = ParamViewer(solver.O)
crv_2 = Curve(solver.O)
planar_2 = IsPlanar(Surface=boundary_2, Interior=True)  # -> Planar, Plane
item_3 = ListItem(List=boundary_2, Index=Slider(80, range=0..100), Wrap=True)
deplane = DeconstructPlane(Plane=item_3)  # -> Origin, XAxis, YAxis, ZAxis
deplane_2 = DeconstructPlane(Plane=boundary_2)  # -> Origin, XAxis, YAxis, ZAxis
rev = Reverse(Vector=deplane_2.ZAxis)
multiplication = Multiplication(A=rev, B=Slider(3, range=0..50))
move = Move(Geometry=item_3, Motion=deplane.ZAxis)  # -> Geometry, Transform
move_2 = Move(Geometry=boundary_2, Motion=multiplication)  # -> Geometry, Transform
merge_2 = Merge(Data1=boundary_2, Data2=move_2.Geometry)
panel = Panel(merge_2)
loft = Loft(Curves=merge_2, Options={Adjust=False, Closed=False, LoftEnds=0, LoftSimp=0, LoftType=0, Rebuild=10, Refit=0.01})
