# Grasshopper definition kangeroo_shell_01.gh (Grasshopper 1.0.7)
# plug-ins: Kangaroo2 Components

crv = Curve(<curve referenced from the Rhino model>)
boundary = BoundarySurfaces(Edges=crv)
mesh = Mesh(boundary)
nv = NakedVertices(Mesh=mesh)  # -> ClothedIndex, NakedIndex, ClothedPts, NakedPts
demesh = DeconstructMesh(Mesh=mesh)  # -> Vertices, Faces, Colours, Normals
edgelengths = EdgeLengths(Mesh=mesh, LengthFactor=Slider(1, range=0..10), Strength=1)
show = Show(G=mesh)
Z = UnitZ(Factor=Slider(4, range=0..10))
pt = Point(Point(-24.00005896, -37.44340083, 0))
pt_2 = Point(Point(-0.7592800403, 41.4428729, 0))
pt_3 = Point(Point(38.54055847, -13.38459683, 0))
cps = ClosestPoints(Point=pt, Cloud=nv.NakedPts, Count=Slider(6, range=0..100))  # -> ClosestPoint, CPIndex, Distance
pt_4 = Point(cps.ClosestPoint)
cps_2 = ClosestPoints(Point=pt_2, Cloud=nv.NakedPts, Count=Slider(7, range=0..100))  # -> ClosestPoint, CPIndex, Distance
pt_5 = Point(cps_2.ClosestPoint)
cps_3 = ClosestPoints(Point=pt_3, Cloud=nv.NakedPts, Count=Slider(7, range=0..100))  # -> ClosestPoint, CPIndex, Distance
pt_6 = Point(cps_3.ClosestPoint)
button = Button()
merge = Merge(Data1=pt_4, Data2=pt_5, Data3=pt_6)
toggle = BooleanToggle(True)
load = Load(Point=demesh.Vertices, ForceVector=Z, Weighting=1)
anchor = Anchor(Point=merge, Strength=10000)
merge_2 = Merge(Data1=show, Data2=edgelengths, Data3=anchor, Data4=load)
zombiesolver = ZombieSolver(GoalObjects=merge_2, Threshold=1e-10, Tolerance=0.01, MaxIterations=50000)  # -> I, V, O
item = ListItem(List=zombiesolver.O, Index=0, Wrap=True)
panel = Panel(zombiesolver.O)
demesh_2 = DeconstructMesh(Mesh=item)  # -> Vertices, Faces, Colours, Normals
