# Grasshopper definition parawall.gh (Grasshopper 1.0.7)

crv = Curve(<curve referenced from the Rhino model>)
number_slider = Slider(26, range=0..100)
srf = Surface(<surface referenced from the Rhino model>)
pt = ConstructPoint(XCoordinate=0, YCoordinate=0, ZCoordinate=0)
neg = Negative(Value=Slider(16, range=0..40))

# ----
# Segment Surface
number_slider_2 = Slider(2, range=0..10)
Z = UnitZ(Factor=number_slider_2)
pl_offset = PlaneOffset(BasePlane=PlaneXY(0, 0, 0), Offset=1)
arrlinear = LinearArray(Geometry=pl_offset, Direction=Z, Count=Slider(21, range=0..100))  # -> Geometry, Transform
sec = BrepPlane(Brep=srf, Plane=arrlinear.Geometry)  # -> flatten(Curves), Points

pt_2 = ConstructPoint(XCoordinate=0, YCoordinate=neg, ZCoordinate=0)
ln = Line(StartPoint=pt, EndPoint=pt_2)
num = Number(2)
X = UnitX(Factor=1)
Z_2 = UnitZ(Factor=1)
move = Move(Geometry=pt, Motion=Z_2)  # -> Geometry, Transform
X_2 = UnitX(Factor=num)
move_2 = Move(Geometry=move.Geometry, Motion=X)  # -> Geometry, Transform
arrlinear_2 = LinearArray(Geometry=ln, Direction=X_2, Count=number_slider)  # -> Geometry, Transform
arrlinear_3 = LinearArray(Geometry=move_2.Geometry, Direction=X_2, Count=number_slider)  # -> Geometry, Transform
clx = CurveLine(Curve=crv, Line=arrlinear_2.Geometry, LimitFirst=True)  # -> Points, Params, Count
box = Box2Pt(PointA=arrlinear_3.Geometry, PointB=clx.Points, Plane=PlaneXY(0, 0, 0))

neg_2 = Negative(Value=Slider(2, range=0..10))
vec = VectorXYZ(XComponent=Slider(1, range=0..10), YComponent=neg_2, ZComponent=Slider(0, range=0..10))  # -> Vector, Length
neg_3 = Negative(Value=Slider(3, range=0..10))
vec_2 = VectorXYZ(XComponent=Slider(2, range=0..10), YComponent=neg_3, ZComponent=Slider(9, range=0..10))  # -> Vector, Length
move_3 = Move(Geometry=pt, Motion=vec.Vector)  # -> Geometry, Transform
move_4 = Move(Geometry=pt, Motion=vec_2.Vector)  # -> Geometry, Transform
box_2 = Box2Pt(PointA=move_3.Geometry, PointB=move_4.Geometry, Plane=PlaneXY(0, 0, 0))
Y = UnitY(Factor=Slider(5, range=0..10))
arrlinear_4 = LinearArray(Geometry=box_2, Direction=X_2, Count=number_slider)  # -> Geometry, Transform
neg_4 = Negative(Value=Y)
arrlinear_5 = LinearArray(Geometry=arrlinear_4.Geometry, Direction=neg_4, Count=Slider(2, range=0..10))  # -> Geometry, Transform

# ----
# Generate Elements
# (straight vectors)
number_slider_3 = Slider(26, range=0..100)
xz = XZPlane(Origin=Point(0, 0, 0))
divide = DivideCurve(Curve=sec.Curves, Count=number_slider_3, Kinks=False)  # -> flatten(Points), Tangents, Parameters
movetoplane = MoveToPlane(Geometry=divide.Points, Plane=xz, Above=True, Below=True)  # -> Geometry, Transform
move_5 = Move(Geometry=movetoplane.Geometry, Motion="{1,0,1}")  # -> Geometry, Transform
box_3 = Box2Pt(PointA=move_5.Geometry, PointB=divide.Points, Plane=PlaneXY(0, 0, 0))

# ----
# Generate Elements
# (straight vectors)
number_slider_4 = Slider(26, range=0..100)
xz_2 = XZPlane(Origin=Point(0, 0, 0))
divide_2 = DivideCurve(Curve=sec.Curves, Count=number_slider_4, Kinks=False)  # -> Points, Tangents, Parameters
movetoplane_2 = MoveToPlane(Geometry=divide_2.Points, Plane=xz_2, Above=True, Below=True)  # -> Geometry, Transform
move_6 = Move(Geometry=movetoplane_2.Geometry, Motion="{1,0,1}")  # -> Geometry, Transform
box_4 = Box2Pt(PointA=move_6.Geometry, PointB=divide_2.Points, Plane=PlaneXY(0, 0, 0))

merge = Merge(Data1=box, Data2=arrlinear_5.Geometry)
srf_cp = SurfaceClosestPoint(Point=divide.Points, Surface=srf)  # -> Point, UVPoint, Distance
evalsrf = EvaluateSurface(Surface=srf, Point=srf_cp.UVPoint)  # -> Point, Normal, UDirection, VDirection, Frame
pi = Pi(Factor=1)
area = Area(Geometry=box_3)  # -> Area, Centroid
multiplication = Multiplication(A=divide.Tangents, B=pi)
multiplication_2 = Multiplication(A=multiplication, B=Slider(7, range=0..10))
viewer = ParamViewer(box_3)
rotate = Rotate(Geometry=box_3, Angle=evalsrf.VDirection, Plane=area.Centroid)  # -> Geometry, Transform
