# Grasshopper definition graph_tool.gh (Grasshopper 1.0.7)

number_slider = Slider(13, range=0..100)
range = Range(Domain=Domain(0, 1), Steps=number_slider)
range_2 = Range(Domain=Slider(50, range=0..100), Steps=number_slider)
graph = GraphMapper(
    range,
    x0=0,
    x1=1,
    y0=0,
    y1=1,
    container_name="Bezier",
    cpx=[0, 0.4591617584, 0.1544646174, 1],
    cpy=[0, 0.1325665712, 0.7122762799, 1])
multiplication = Multiplication(A=Slider(50, range=0..1000), B=graph)
panel = Panel(range_2)
pt = ConstructPoint(XCoordinate=range_2, YCoordinate=multiplication, ZCoordinate=0)
