# Grasshopper definition 2_trouchet_tiles.gh (Grasshopper 1.0.7)

sqgrid = Square(Plane=PlaneXY(0, 0, 0), Size=1, ExtentX=Slider(28, range=0..100), ExtentY=Slider(27, range=0..100))  # -> graft(Cells), Points
panel = Panel(sqgrid.Cells)
pcen = PolygonCenter(Polyline=sqgrid.Cells)  # -> CenterV, CenterE, CenterA
explode = Explode(Curve=sqgrid.Cells, Recursive=True)  # -> Segments, Vertices
number_slider = Slider(0.3, range=0..1)
eval = EvaluateLength(Curve=explode.Segments, Length=Slider(0.5, range=0..1), Normalized=True)  # -> Point, Tangent, Parameter
tstat = TreeStatistics(Tree=sqgrid.Cells)  # -> Paths, Length, Count
item = ListItem(List=eval.Point, Index=0, Wrap=True)  # -> Item, Item1, Item2, Item3
pt = Point(pcen.CenterV)
Y = UnitY(Factor=number_slider)
X = UnitX(Factor=number_slider)
bzspan = BezierSpan(StartPoint=item.Item, StartTangent=Y, EndPoint=item.Item3, EndTangent=X)  # -> Curve, Length, Domain
random = Random(Range="0 to 3", Number=tstat.Count, Seed=Slider(1262, range=0..10000), Integers=True)  # -> graft(Random)
multiplication = Multiplication(A=random, B="90")
rot3d = Rotate3D(Geometry=bzspan.Curve, Angle=degrees("180"), Center=pt, Axis=Vector(0, 0, 1))  # -> Geometry, Transform
merge = Merge(Data1=bzspan.Curve, Data2=rot3d.Geometry)
rot3d_2 = Rotate3D(Geometry=merge, Angle=degrees(multiplication), Center=pt, Axis=Vector(0, 0, 1))  # -> flatten(Geometry), Transform
join = JoinCurves(Curves=rot3d_2.Geometry, Preserve=False)
