# Grasshopper definition 2D_linegrowth.gh (Grasshopper 1.0.7)
# plug-ins: Kangaroo2 Components

crv = Curve(<curve referenced from the Rhino model>)
planesrf = PlaneSurface(Plane=PlaneXY(0, 0, 0), XSize=Slider(83, range=0..100), YSize=Slider(100, range=0..100))
divide = DivideCurve(Curve=crv, Count=Slider(2000, range=0..10000), Kinks=False)  # -> flatten(Points), Tangents, Parameters
pline = PolyLine(Vertices=divide.Points, Closed=False)
disc = Discontinuity(Curve=pline, Level=2)  # -> Points, Parameters
explode = Explode(Curve=pline, Recursive=True)  # -> Segments, Vertices
len = Length(Curve=explode.Segments)
avr = Average(Input=len)
multiplication = Multiplication(A=avr, B=Slider(19, range=0..150))
length_line = LengthLine(Line=explode.Segments, Length=multiplication, Strength=10)
onmesh = OnMesh(Points=disc.Points, Mesh=planesrf, Strength=1)
sc = SphereCollide(Points=disc.Points, Radius=multiplication, Strength=1)
merge = Merge(Data1=length_line, Data2=sc, Data3=onmesh)
solver = Solver(GoalObjects=merge, Reset=Button(), Threshold=1e-15, Tolerance=0.01, On=Toggle(False))  # -> I, V, O
number_slider = Slider(1, range=0..1)
pline_2 = PolyLine(Vertices=solver.V, Closed=False)
simplify = SimplifyCurve(Curve=pline_2)  # -> Curve, Simplified
smoothpline = SmoothPolyline(Polyline=pline_2, Strength=1, Times=1)
reb = RebuildCurve(Curve=pline_2, Count=Slider(100, range=0..100), Tangents=False)
