# Grasshopper definition spiral.gh (Grasshopper 1.0.7)
# plug-ins: ClipperComponents

number_slider = Slider(0.1, range=0..0.1)
txt = Text()
c_script = CSharpScript(rad=Slider(7, range=0..10), paper=Slider(0.2, range=0..1))  # -> out, A, B, graft(C), graft(D); inputs rad: Int32, paper: Double
# ---------- c_script: C# ----------
List<Point3d> plist = new List<Point3d>();
List<int> heights = new List<int>();
List <Circle> circles = new List<Circle>();
List<Rectangle3d> recs = new List<Rectangle3d>();

Vector3d v = new Vector3d(0,0,1);


double angle = 2* Math.PI / 40;
int sheets = 30;


double _x = 0;
double _y = 0;
double paper_index = 0;
double radi = 5;

for(int i = 0; i < sheets; i++){
    _x = Math.Cos(angle*i)*rad;
    _y = Math.Sin(angle*i)*rad;
    plist.Add(new Point3d(_x, _y,paper_index));
    heights.Add(i);
    circles.Add(new Circle(new Point3d(_x, _y,paper_index), radi));

    Plane p = new Plane(new Point3d(-rad-25,-rad-25,paper_index), v);
    recs.Add(new Rectangle3d(p, 50+rad,50+rad));

    paper_index = paper_index+paper;
    radi += 0.5;
}

A = plist;
B = heights;
C = circles;
D = recs;
# ---------- end c_script ----------
points = PointList(Points=c_script.A)
merge = Merge(Data1=c_script.C, Data2=c_script.D)
number_slider_2 = Slider(0, range=0..10)
panel = Panel(merge)
branch = TreeBranch(MaintainPaths=True)
item = ListItem(List=c_script.D, Index=number_slider_2, Wrap=True)
polyboolean = PolylineBoolean(
    A=c_script.D,
    B=c_script.C,
    BooleanType=Slider(4, range=0..10),
    Plane=Plane(origin=(0, 0, 0), x=(0, 0, 0), y=(0, 0, 0)),
    Tolerance=0.001,
    EvenOdd=True)
item_2 = ListItem(List=polyboolean, Index=number_slider_2, Wrap=True)
boundary = BoundarySurfaces(Edges=polyboolean)
number_slider_3 = Slider(0, range=0..1)
Z = UnitZ(Factor=Slider(0.2, range=0..1))
extr = Extrude(Base=boundary, Direction=Z)
